vi "Tx and Rx Streaming (Host).gvi"   [LabVIEW NXG 4.0.0]
# This template is for the Simple NI-USRP Streaming design, a design that shows the basics of streaming data to and from an NI USRP-294x/295x device. Refer to the block diagram for more information about how to use this template.
panel controls:
  "Tab": i32
  "USRP RIO device": string = "RIO0"
  "Reference Frequency Source": string = "Internal"
  "tx.stop": bool
  "rx.stop": bool
  "Tab_2": i32
  "tx config": T7 = {"rf enable 0"=TRUE, "rf config 0"={"Antenna RF 0"="TX1", "Frequency RF 0 [Hz]"=2000000000, "LO Frequency RF 0 [Hz]"=-1, "Output Power RF 0 [dBm]"=0}, "rf enable 1"=TRUE, "rf config 1"={"Antenna RF 1"="TX1", "Frequency RF 1 [Hz]"=2000000000, "LO Frequency RF 1 [Hz]"=-1, "Output Power RF 1 [dBm]"=0}, "Generation Mode"="Finite", "Sample Rate [S/s]"=10000000, "Number of Samples"=8192, "Start Trigger"="Immediate", "Tone Frequency [Hz]"=100000}
  "rx config": T10 = {"rf enable 0"=TRUE, "rf config 0"={"Antenna RF 0"="RX2", "Frequency RF 0 [Hz]"=2000000000, "LO Frequency RF 0 [Hz]"=-1, "Reference Level RF 0 [dBm]"=0}, "rf enable 1"=TRUE, "rf config 1"={"Antenna RF 1"="RX2", "Frequency RF 1 [Hz]"=2000000000, "LO Frequency RF 1 [Hz]"=-1, "Reference Level RF 1 [dBm]"=0}, "Acquisition Mode"="Finite", "Sample Rate [S/s]"=10000000, "Number of Samples"=8192, "Start Trigger"="Immediate"}
panel indicators:
  "Power Spectrum": T1[]
  "Power Level": f64[][]
  "I & Q Data": f64[][]
  "Output Waveform": waveform<f64>[]
  "TX Coerced Configurations": T2
  "RX Coerced Configurations": T3
  "Acquiring": bool
  "Generating": bool
  "HEst": c128[]
  "RefreshRate": f64
types:
  T1 = cluster{"f0": f64, "df": f64, "magnitude": f64[]}
  T2 = cluster{"Coerced Frequencies [Hz]": f64[], "Coerced LO Frequencies [Hz]": f64[], "Coerced Output Powers [dBm]": f64[], "Coerced Sample Rates [S/s]": f64[]}
  T3 = cluster{"Coerced Frequencies [Hz]": f64[], "Coerced LO Frequencies [Hz]": f64[], "Coerced Levels [dBm]": f64[], "Coerced Sample Rates [S/s]": f64[]}
  T4 = cluster{"Antenna RF 0": string, "Frequency RF 0 [Hz]": f64, "LO Frequency RF 0 [Hz]": f64, "Output Power RF 0 [dBm]": f64}
  T5 = cluster{"Antenna RF 1": string, "Frequency RF 1 [Hz]": f64, "LO Frequency RF 1 [Hz]": f64, "Output Power RF 1 [dBm]": f64}
  T6 = enum{"Software", "Digital Edge", "Rx Start Trigger", "Tx Start Trigger", "Immediate", "Future Time Event"}
  T7 = cluster{"rf enable 0": bool, "rf config 0": T4, "rf enable 1": bool, "rf config 1": T5, "Generation Mode": enum{"Finite", "Continuous"}, "Sample Rate [S/s]": f64, "Number of Samples": u32, "Start Trigger": T6, "Tone Frequency [Hz]": f64}
  T8 = cluster{"Antenna RF 0": string, "Frequency RF 0 [Hz]": f64, "LO Frequency RF 0 [Hz]": f64, "Reference Level RF 0 [dBm]": f64}
  T9 = cluster{"Antenna RF 1": string, "Frequency RF 1 [Hz]": f64, "LO Frequency RF 1 [Hz]": f64, "Reference Level RF 1 [dBm]": f64}
  T10 = cluster{"rf enable 0": bool, "rf config 0": T8, "rf enable 1": bool, "rf config 1": T9, "Acquisition Mode": enum{"Finite", "Continuous"}, "Sample Rate [S/s]": f64, "Number of Samples": u32, "Start Trigger": T6}
uses:
  Host SubVIs::Open and Configure Device.gvi
  NI::G Core::Timing::Elapsed Timer.gvi
  Host SubVIs::Initiate and Fetch (Single).gvi
  Host SubVIs::Calculate Power.gvi
  Host SubVIs::Initiate and Generate (Single).gvi
  Host SubVIs::Close Device.gvi
  NI::G Core::Error::Display Error.gvi
diagram:
  # 1. Open and configure device
  # 2a. Receive data
  # 2b. Transmit data
  # 3. Close device
  # 1.
  call "Open and Configure Device.gvi"(rx config=$"rx config", tx config=$"tx config", USRP RIO Device=$"USRP RIO device", reference frequency source=$"Reference Frequency Source") -> (niUsrpRio Session (out)=w1, rx.coerced configurations=w2, tx.coerced configurations=w3, tx.output waveform=w4, error out=w5, rx channels=w6, tx channels=w7)
  call "Elapsed Timer.gvi"(target time=1) -> (time has elapsed=w8)
  case (w8) {
    frame False, Default {
      w9 = default
    }
    frame True {
      w9 = 0
    }
  }
  s1 = w5  # shift register
  while (iteration -> i1) {
    call "Elapsed Timer.gvi"(target time=0.05) -> (time has elapsed=w10)
    Is Equal To 0(x=i1) -> w11
    call "Initiate and Fetch (Single).gvi"(niUsrpRio Session=w1, first iteration=w11, error in=s1, rx channels=w6) -> (niUsrpRio Session (out)=w12, complex baseband data=w13, error out=w14)
    # 2a.
    case (w10) {
      frame False, Default { }
      frame True {
        Array Index(array=w13) -> (out0[0]=w15)
        Property Node(instance in=w15) -> ("Y"=w16)
        $HEst <- w16
        Array Index(array=w13)
        Feedback Node(initial value=w9, input=w17) -> w18
        Increment(x=w18) -> w17
        $RefreshRate <- w17
        call "Calculate Power.gvi"(waveform=w13) -> (Power Spectrum=w19, Power Level=w20, I & Q Data=w21)
        $"Power Spectrum" <- w19
        $"Power Level" <- w20
        $"I & Q Data" <- w21
      }
    }
    Logical Or(w14, $"rx.stop") -> w22
    Not(x=w22) -> w23
    $Acquiring <- w23
    next s1 = w14
    stop if w22
  }
  s2 = w5  # shift register
  while (iteration -> i2) {
    Is Equal To 0(x=i2) -> w24
    # 2b.
    call "Initiate and Generate (Single).gvi"(niUsrpRio Session=w1, first iteration=w24, error in=s2, tx channels=w7) -> (error out=w25)
    Logical Or(w25, $"tx.stop") -> w26
    Not(x=w26) -> w27
    $Generating <- w27
    next s2 = w25
    stop if w26
  }
  Merge Errors(s1, s2) -> (error out=w28)
  # 3.
  call "Close Device.gvi"(niusrprio session in=w12, error in=w28) -> (error out=w29)
  call "Display Error.gvi"(error in=w29, type of dialog="OK message + warnings")
  $"RX Coerced Configurations" <- w2
  $"TX Coerced Configurations" <- w3
  $"Output Waveform" <- w4
